# Grasshopper definition M3_Design1.gh (Grasshopper 1.0.8)
# plug-ins: LunchBox

# ----
# Maximum Size of Output
number_slider = Slider(60, range=0..100)
rectangle = Rectangle(Plane=PlaneXY(0, 0, 0), XSize=number_slider, YSize=number_slider, Radius=0)  # -> Rectangle, Length
division = Division(A=number_slider, B="-2")
vector_xyz = VectorXYZ(XComponent=division, YComponent=division, ZComponent=0)  # -> Vector, Length
move = Move(Geometry=rectangle.Rectangle, Motion=vector_xyz.Vector)  # -> Geometry, Transform
box_rectangle = BoxRectangle(Rectangle=move.Geometry, Height=number_slider)

twist_angle = Slider(0.656, range=0..62.832)

# ----
# Ellipse 4
number_slider_2 = Slider(25, range=0..30)
number_slider_3 = Slider(25, range=0..30)
number_slider_4 = Slider(24, range=0..60)
vector_xyz_2 = VectorXYZ(XComponent=Slider(0, range=0..60), YComponent=Slider(0, range=0..60), ZComponent=number_slider_4)  # -> Vector, Length
ellipse = Ellipse(Plane=PlaneXY(0, 0, 0), Radius1=number_slider_2, Radius2=number_slider_3)  # -> Ellipse, Focus1, Focus2
move_2 = Move(Geometry=ellipse.Ellipse, Motion=vector_xyz_2.Vector)  # -> Geometry, Transform

number_slider_5 = Slider(2.26, range=0..10)

# ----
# Create Cuttout for Storage and Tabletop
number_slider_6 = Slider(0, range=0..60)
storage_radius = Slider(48, range=0..60)
storage_depth = Slider(17, range=0..60)
height_of_lip_negative_space = Subtraction(A=number_slider_4, B=number_slider_5)
subtraction = Subtraction(A=height_of_lip_negative_space, B=storage_depth)
subtraction_2 = Subtraction(A=number_slider_3, B=storage_radius)
vector_xyz_3 = VectorXYZ(XComponent=number_slider_6, YComponent=Slider(0, range=0..60), ZComponent=height_of_lip_negative_space)  # -> Vector, Length
vector_xyz_4 = VectorXYZ(XComponent=Slider(0, range=0..60), YComponent=Slider(0, range=0..60), ZComponent=subtraction)  # -> Vector, Length
cylinder = Cylinder(Base=PlaneXY(0, 0, 0), Radius=number_slider_3, Length=number_slider_5)
cylinder_2 = Cylinder(Base=PlaneXY(0, 0, 0), Radius=subtraction_2, Length=storage_depth)
lip_for_glass_tabletop = Move(Geometry=cylinder, Motion=vector_xyz_3.Vector)  # -> Geometry, Transform
storage_space = Move(Geometry=cylinder_2, Motion=vector_xyz_4.Vector)  # -> Geometry, Transform
cap_holes = CapHoles(Brep=storage_space.Geometry)
cap_holes_2 = CapHoles(Brep=lip_for_glass_tabletop.Geometry)
solid_union = SolidUnion(Breps=[cap_holes_2, cap_holes])

# ----
# Ellipse 1
number_slider_7 = Slider(25, range=0..30)
number_slider_8 = Slider(0, range=0..60)
vector_xyz_5 = VectorXYZ(XComponent=Slider(0, range=0..60), YComponent=Slider(0, range=0..60), ZComponent=number_slider_8)  # -> Vector, Length
ellipse_2 = Ellipse(Plane=PlaneXY(0, 0, 0), Radius1=number_slider_7, Radius2=Slider(25, range=0..30))  # -> Ellipse, Focus1, Focus2
move_3 = Move(Geometry=ellipse_2.Ellipse, Motion=vector_xyz_5.Vector)  # -> Geometry, Transform

subtraction_3 = Subtraction(A=number_slider_4, B=Slider(5, range=0..60))

# ----
# Ellipse 3
number_slider_9 = Slider(30, range=0..30)
ellipse_3 = Ellipse(Plane=PlaneXY(0, 0, 0), Radius1=number_slider_9, Radius2=Slider(30, range=0..30))  # -> Ellipse, Focus1, Focus2
vector_xyz_6 = VectorXYZ(XComponent=Slider(0, range=0..60), YComponent=Slider(0, range=0..60), ZComponent=subtraction_3)  # -> Vector, Length
move_4 = Move(Geometry=ellipse_3.Ellipse, Motion=vector_xyz_6.Vector)  # -> Geometry, Transform

# ----
# Create "Glass" table top
tolerance = Slider(1.028, range=0..3)
subtraction_4 = Subtraction(A=number_slider_3, B=tolerance)
subtraction_5 = Subtraction(A=number_slider_3, B=tolerance)
vector_xyz_7 = VectorXYZ(XComponent=Slider(84, range=0..120), YComponent=Slider(60, range=0..60), ZComponent=Slider(0, range=0..60))  # -> Vector, Length
ellipse_4 = Ellipse(Plane=PlaneXY(0, 0, 0), Radius1=subtraction_4, Radius2=subtraction_5)  # -> Ellipse, Focus1, Focus2
vector_xyz_8 = VectorXYZ(XComponent=Slider(60, range=0..60), YComponent=Slider(60, range=0..60), ZComponent=Slider(0, range=0..60))  # -> Vector, Length
ellipse_5 = Ellipse(Plane=PlaneXY(0, 0, 0), Radius1=Slider(4, range=0..10), Radius2=Slider(6, range=0..10))  # -> Ellipse, Focus1, Focus2
vector_xyz_9 = VectorXYZ(XComponent=Slider(36, range=0..60), YComponent=Slider(60, range=0..60), ZComponent=Slider(0, range=0..60))  # -> Vector, Length
move_5 = Move(Geometry=ellipse_5.Ellipse, Motion=vector_xyz_7.Vector)  # -> Geometry, Transform
ellipse_6 = Ellipse(Plane=PlaneXY(0, 0, 0), Radius1=Slider(4, range=0..10), Radius2=Slider(6, range=0..10))  # -> Ellipse, Focus1, Focus2
move_6 = Move(Geometry=ellipse_4.Ellipse, Motion=vector_xyz_8.Vector)  # -> Geometry, Transform
move_7 = Move(Geometry=ellipse_6.Ellipse, Motion=vector_xyz_9.Vector)  # -> Geometry, Transform
region_difference = RegionDifference(CurvesA=move_6.Geometry, CurvesB=move_5.Geometry)
region_difference_2 = RegionDifference(CurvesA=region_difference, CurvesB=move_7.Geometry)

# ----
# Ellipse 2
number_slider_10 = Slider(30, range=0..30)
ellipse_7 = Ellipse(Plane=PlaneXY(0, 0, 0), Radius1=number_slider_10, Radius2=Slider(30, range=0..30))  # -> Ellipse, Focus1, Focus2

addition = Addition(A=number_slider_8, B=Slider(5, range=0..60))

vector_xyz_10 = VectorXYZ(XComponent=Slider(0, range=0..60), YComponent=Slider(0, range=0..60), ZComponent=addition)  # -> Vector, Length
move_8 = Move(Geometry=ellipse_7.Ellipse, Motion=vector_xyz_10.Vector)  # -> Geometry, Transform

# ----
# Create Solid Form
v_divisions = Slider(26, range=0..100)
u_divisions = Slider(3, range=0..100)
loft = Loft(
    Curves=[move_3.Geometry, move_8.Geometry, move_4.Geometry, move_2.Geometry],
    Options={Adjust=False, Closed=False, LoftEnds=0, LoftSimp=0, LoftType=0, Rebuild=10, Refit=0.01})
diamond_panels = DiamondPanels(Surface=loft, UDivisions=u_divisions, VDivisions=v_divisions)  # -> DiamondPanels, TriPanels
curve = Curve(move_2.Geometry)
curve_2 = Curve(move_3.Geometry)
curve_3 = Curve(diamond_panels.TriPanels)
top_face = Area(Geometry=move_3.Geometry, UseTasks=False)  # -> Area, Centroid
bottom_face = Area(Geometry=move_2.Geometry)  # -> Area, Centroid
boundary_surfaces = BoundarySurfaces(Edges=[curve, curve_2, curve_3])
twist_axis = Line(StartPoint=top_face.Centroid, EndPoint=bottom_face.Centroid)
twist = Twist(
    Geometry=[boundary_surfaces, diamond_panels.DiamondPanels],
    Axis=twist_axis,
    Angle=twist_angle,
    Infinite=False,
    Rigid=False)
custom_preview = CustomPreview(
    Geometry=[diamond_panels.DiamondPanels, twist],
    Material={diffuse=RGB(228, 178, 227), emission=RGB(68, 53, 68), shine=0.5, specular=RGB(255, 254, 255), transparency=0})

solid_difference = SolidDifference(BrepsA=twist, BrepsB=solid_union)
